# Grasshopper definition bibil_acadia_22_minimal.gh (Grasshopper 0.9.76)
# plug-ins: Python Interpreter, HDTReference

list = ValueList({"dir", "file"}, selected="dir")

# ---- group: find directory
bibil = PythonScript(
    dir=["C:\\Users\\vasanthakumars\\Documents\\GitHub\\bibil\\src", "C:\\saeran\\master\\git\\bibil\\src"],
    type=list,
    run=Toggle(True))  # -> dir; inputs dir: list
# ---------- bibil: Python ----------
import os
import sys

ghenv.Component.Params.Output[0].Name = "null"
ghenv.Component.Params.Output[0].NickName = "null"

#sys.path.append("C:\Program Files\Rhinoceros 5.0 (64-bit)\System")

if run:
    confirm_dir = None
    for d in dir:
        try:
            if type == "file":
                file_ = open(d)
                file_.close()
            else:
                print os.listdir(d)
            confirm_dir = d
            break
        except Exception as e:
            #print str(e)
            continue
    if confirm_dir != None:
        ghenv.Component.Params.Output[0].Name = type
        ghenv.Component.Params.Output[0].NickName = type
        dir = confirm_dir
        file = confirm_dir
null = None
# ---------- end bibil ----------

# ---- group: node_bucket
python_script = PythonScript(i=bibil)  # -> o
# ---------- python_script: Python ----------
import os

if i:
    o = os.path.join(str(i),"miru\\miru_shape_bucket.py")
# ---------- end python_script ----------
file = ReadFile(File=python_script, PerLineParse=False)

# ---- group: stepback_manual
python_script_2 = PythonScript(i=bibil)  # -> o
# ---------- python_script_2: Python ----------
import os

if i:
    o = os.path.join(str(i),"miru\\miru_stepback_manual.py")
# ---------- end python_script_2 ----------
file_2 = ReadFile(File=python_script_2, PerLineParse=False)

# ---- group: tree
python_script_3 = PythonScript(i=bibil)  # -> o
# ---------- python_script_3: Python ----------
import os

if i:
    o = os.path.join(str(i),"bibil\\bibil_tree.py")
# ---------- end python_script_3 ----------
file_3 = ReadFile(File=python_script_3, PerLineParse=False)
bibil_2 = PythonScript(Code=file_3)

# ---- group: grammar
python_script_4 = PythonScript(i=bibil)  # -> o
# ---------- python_script_4: Python ----------
import os

if i:
    o = os.path.join(str(i),"bibil\\bibil_grammar.py")
# ---------- end python_script_4 ----------
file_4 = ReadFile(File=python_script_4, PerLineParse=False)
bibil_3 = PythonScript(Code=file_4)

# ---- group: shape
python_script_5 = PythonScript(i=bibil)  # -> o
# ---------- python_script_5: Python ----------
import os

if i:
    o = os.path.join(str(i),"bibil\\bibil_shape.py")
#o = os.path.join(str(i),"research\\bibil_shape_shape_3d_2d.py")
# ---------- end python_script_5 ----------
file_5 = ReadFile(File=python_script_5, PerLineParse=False)
bibil_4 = PythonScript(Code=file_5)

# ---- group: bula
python_script_6 = PythonScript(i=bibil)  # -> o
# ---------- python_script_6: Python ----------
import os

if i:
    o = os.path.join(str(i),"bula\\bula_minimal.py")
# ---------- end python_script_6 ----------
file_6 = ReadFile(File=python_script_6, PerLineParse=False)
bibil_5 = PythonScript(Code=file_6)

# ---- group: UI
python_script_7 = PythonScript(i=bibil)  # -> o
# ---------- python_script_7: Python ----------
import os

if i:
    o = os.path.join(str(i),"bibil\\bibil_UI.py")
# ---------- end python_script_7 ----------
file_7 = ReadFile(File=python_script_7, PerLineParse=False)

# ---- group: grammar_divide
python_script_8 = PythonScript(i=bibil)  # -> o
# ---------- python_script_8: Python ----------
import os

if i:
    o = os.path.join(str(i),"miru\\miru_divide.py")
# ---------- end python_script_8 ----------
file_8 = ReadFile(File=python_script_8, PerLineParse=False)

# ---- group: grammar_courtyard
python_script_9 = PythonScript(i=bibil)  # -> o
# ---------- python_script_9: Python ----------
import os

if i:
    o = os.path.join(str(i),"miru\\miru_court.py")
# ---------- end python_script_9 ----------
file_9 = ReadFile(File=python_script_9, PerLineParse=False)

# ---- group: grammar_tower
python_script_10 = PythonScript(i=bibil)  # -> o
# ---------- python_script_10: Python ----------
import os

if i:
    o = os.path.join(str(i),"miru\\miru_packing.py")
# ---------- end python_script_10 ----------
file_10 = ReadFile(File=python_script_10, PerLineParse=False)

# ---- group: stepback
python_script_11 = PythonScript(i=bibil)  # -> o
# ---------- python_script_11: Python ----------
import os

if i:
    o = os.path.join(str(i),"miru\\miru_stepback.py")
# ---------- end python_script_11 ----------
file_11 = ReadFile(File=python_script_11, PerLineParse=False)

# ---- group: grammar_height
python_script_12 = PythonScript(i=bibil)  # -> o
# ---------- python_script_12: Python ----------
import os

if i:
    o = os.path.join(str(i),"miru\\miru_height.py")
# ---------- end python_script_12 ----------
file_12 = ReadFile(File=python_script_12, PerLineParse=False)

# ---- group: grammar_analysis_pts
python_script_13 = PythonScript(i=bibil)  # -> o
# ---------- python_script_13: Python ----------
import os

if i:
    o = os.path.join(str(i),"miru\\miru_analysis.py")
# ---------- end python_script_13 ----------
file_13 = ReadFile(File=python_script_13, PerLineParse=False)

# ---- group: meta_tree
python_script_14 = PythonScript(i=bibil)  # -> o
# ---------- python_script_14: Python ----------
import os

if i:
    o = os.path.join(str(i),"miru\\miru_meta_tree.py")
# ---------- end python_script_14 ----------
file_14 = ReadFile(File=python_script_14, PerLineParse=False)

# ---- group: land_use
python_script_15 = PythonScript(i=bibil)  # -> o
# ---------- python_script_15: Python ----------
import os

if i:
    o = os.path.join(str(i),"miru\\miru_landuse.py")
# ---------- end python_script_15 ----------
file_15 = ReadFile(File=python_script_15, PerLineParse=False)

# ---- group: shape2height
python_script_16 = PythonScript(i=bibil)  # -> o
# ---------- python_script_16: Python ----------
import os

if i:
    o = os.path.join(str(i),"miru\\miru_shape2height.py")
# ---------- end python_script_16 ----------
file_16 = ReadFile(File=python_script_16, PerLineParse=False)

# ---- group: extract_slice
python_script_17 = PythonScript(i=bibil)  # -> o
# ---------- python_script_17: Python ----------
import os

if i:
    o = os.path.join(str(i),"miru\\miru_extract_slice.py")
# ---------- end python_script_17 ----------
file_17 = ReadFile(File=python_script_17, PerLineParse=False)

# ----
list_2 = ValueList({"divide by depth": "subdivide_depth", "divide by same depth": "subdivide_depth_same", "divide by dim": "subdivide_dim"}, selected="divide by same depth")
list_3 = ValueList({"YZ": "NS", "XZ": "EW", "XY": "Z"}, selected="XZ")

# ---- group: SETBACK
miru = PythonScript(Code=file_11, Height_stepback="22.5:6.0", Run=Toggle(False))

# ---- group: PACKING
separatedata = Ladybug_SeparateData(Code=file_10, X_keep_omit="27.0,25.0", Y_keep_omit="27.0,25.0", Seperation_ref="-1", Run=Toggle(False))

# ---- group: ENERGY_MODEL_BUCKET
miru_2 = PythonScript(Code=file, Run=Toggle(True))

# ---- group: EXTRACT_SLICE
miru_3 = PythonScript(Code=file_17, Run=Toggle(False))

# ---- group: DIVIDE
miru_4 = PythonScript(
    Code=file_8,
    Divide_num=Slider(2, range=0..10),
    Divide_cut=Slider(0, range=0..100),
    Divide_type=list_2,
    Divide_ratio=Slider(0.5, range=0..1),
    Axis=list_3,
    Run=Toggle(False))

# ---- group: PERIMETER
miru_5 = PythonScript(Code=file_9, Width=Slider(20, range=0..100), Cut_width=Slider(0, range=0..100), Court_ref="0", Run=Toggle(False))

# ---- group: HEIGHT
miru_6 = PythonScript(Code=file_12, Height=Slider(16.5, range=0..100), Run=Toggle(True))

# ---- group: TREE RULES
miru_7 = PythonScript(Code=file_14, Run=Toggle(False))

# ---- group: SHAPE2HEIGHT
miru_8 = PythonScript(Code=file_16, Run=Toggle(False))

# ----
geo = Geometry(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)
geo_2 = Geometry(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)
geo_3 = Geometry([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])

# ---- group: META-RES
bibil_6 = PythonScript(Code=file_7, Node_in=flatten(geo), Label_="ResRoot", Run=Toggle(True))  # -> Node_out, Debug

# ---- group: META-COM
bibil_7 = PythonScript(Code=file_7, Node_in=flatten(geo_2), Label_="ComRoot", Run=Toggle(True))  # -> Node_out, Debug

# ----
bibil_8 = PythonScript(Code=file_7, Node_in=flatten(geo_3), Label_="d1", Run=Toggle(True))  # -> Node_out, Debug
data = Data([bibil_6.Node_out, bibil_7.Node_out])
data_2 = Data(bibil_8.Node_out)

# ---- group: PODIUM HEIGHT
number_slider = Slider(5, range=0..8, expression="(x*3) + 7.5")

# ---- group: DENSITY_UNIFORMITY
number_slider_2 = Slider(0, range=0..4)

# ----
python = PythonScript(init_zones=data, init_nodes=data_2, run=Toggle(True))  # -> res_node, com_node; inputs init_zones: list, init_nodes: list
# ---------- python: Python ----------
import random
import scriptcontext as sc
import Rhino as rc
import rhinoscriptsyntax as rs

import Grasshopper
import Grasshopper.Kernel as gh
import scriptcontext as sc
ghenv.Component.Message = 'Bibil_1'

Bula = sc.sticky['Bula']
Grammar = sc.sticky['Grammar']
sc.sticky['GLOBAL_COLLISION_LIST'] = []

def normalize_all_heights(raw_nodes):
    D={}
    max = raw_nodes[0].shape.ht
    min = raw_nodes[0].shape.ht
    htlst = []
    for i in xrange(len(raw_nodes)):
        ht = raw_nodes[i].shape.ht
        if ht>max:
            max = ht
        if ht<min:
            min = ht
        htlst.append(ht)
    #max and min heights
    normlst = B.normalize_list(htlst,91.5,10.5)
    map(lambda nh: nh[0].shape.op_extrude(nh[1]),zip(raw_nodes,normlst))
    return raw_nodes
def set_parcel_by_zone(parcel_,zone_):
    L = []
    cpt = parcel_.shape.cpt
    for j in xrange(len(zone_)):
        zonecrv = zone_[j]
        #debug.append(zonecrv)
        IsIn = rs.PointInPlanarClosedCurve(cpt,zonecrv)
        if IsIn>0.5:
            IsDefined = True
            #debug.append(parcel)
            L.append(parcel_)
            break
    return L

if run:
    B = Bula()
    G = Grammar()
    # Normalize all heights
    norm_nodes = normalize_all_heights(init_nodes)
    
    # Sort the parcels by res/com boundaries
    # There needs to be a better spatial partiioning algorithm to do this part
    # Time complexity = O(2m) + O(4n)
    
    res_zones = []
    res_parcels,com_parcels = [],[]
    
    for i in xrange(len(init_zones)):
        zone = init_zones[i]
        if 'res' in zone.grammar.type['label'].lower():
            res_zones.append(zone.shape.bottom_crv)
            
    for i in xrange(len(norm_nodes)):
        norm = norm_nodes[i]
        IsInRes = set_parcel_by_zone(norm,res_zones)
        if IsInRes:
            res_parcels.append(norm)
        else:
            com_parcels.append(norm)
    
    zone_lst = [res_parcels, com_parcels]
    
    # Bucket according to density label
    bucket_dict = {"apply2list":True, "keys2bucket":["label"],\
                    "fx2bucket":"lambda n:n.grammar.type['label']"}
    for i in xrange(len(zone_lst)):
        nodesbytype = zone_lst[i]
        bucketed_lst = G.bucket_shape(nodesbytype,bucket_dict)
        nestedbylabel = bucketed_lst[0]
        nestedbylabel.sort(key=lambda tple:tple[0])
        zone_lst[i] = map(lambda l:l[1],nestedbylabel)
    
    res_node = zone_lst[0]
    com_node = zone_lst[1]
# ---------- end python ----------

# ----
# DEMAND
# PARAMETER
podium_ht = PythonScript(node_in=python.res_node, ht_threshold=number_slider, density_index=number_slider_2)  # -> hi, lo; inputs node_in: list, density_index: Int32
# ---------- podium_ht: Python ----------
import Grasshopper
import Grasshopper.Kernel as gh

ghenv.Component.Message = 'Bibil_2'


def set_density(parcel):
    lo,hi = [],[]
    for i in xrange(len(parcel)):
        pa = parcel[i]
        x_dist = pa.shape.x_dist
        y_dist = pa.shape.y_dist
        demand_ = pa.shape.ht
        
        # HIRISE
        if demand_ > MIN_HI_HT and x_dist > MIN_HI_DIST and y_dist > MIN_HI_DIST:
            hi.append(pa)
        # LOWRISE
        else:
            lo.append(pa)
    return hi,lo

if node_in:
    MIN_HI_DIST = 20.0
    MIN_HI_HT = ht_threshold
    select_node = node_in[density_index]
    hi,lo = set_density(select_node)
# ---------- end podium_ht ----------

# ----
# DEMAND
# PARAMETER
podium_ht_2 = PythonScript(node_in=python.com_node, ht_threshold=number_slider, density_index=number_slider_2)  # -> hi, lo; inputs node_in: list, density_index: Int32; same code as podium_ht

# ---- group: DON'T PASS NODES
g = PythonScript(node=podium_ht.hi)  # -> geom; inputs node: list
# ---------- g: Python ----------
node = filter(lambda n: n!=None,node)
if node and node != []:
    geom = []
    for n in node:
        if n.shape.z_dist < 1.2:
            geom.append(n.shape.bottom_crv)
        else:
            geom.append(n.shape.geom)
    print geom
# ---------- end g ----------
g_2 = PythonScript(node=podium_ht.lo)  # -> geom; inputs node: list; same code as g

g_3 = PythonScript(node=podium_ht_2.hi)  # -> geom; inputs node: list; same code as g
g_4 = PythonScript(node=podium_ht_2.lo)  # -> geom; inputs node: list; same code as g

# ----
# STREETS
number_slider_3 = Slider(5, range=0..100)
# AVENUES
number_slider_4 = Slider(10, range=0..100)

# ---- group: SET/STEPBACK
number_slider_5 = Slider(1, range=0..6, expression="x*0.75")

# ----
geo_4 = Geometry(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)
geo_5 = Geometry([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])

# ----
# PODIUM HT
# PARAMETER
data_3 = Data(number_slider)

preview = CustomPreview(Geometry=geo_4, Shader=ColourSwatch(SwatchColor=RGB(255, 255, 255)))
preview_2 = CustomPreview(Geometry=geo_5, Shader=ColourSwatch(SwatchColor=RGB(255, 255, 255)))
toggle = BooleanToggle(True)
# PODIUM
toggle_2 = BooleanToggle(True)

# ---- group: SETBACK
miru_9 = PythonScript(
    Code=file_2,
    Height_stepback=Slider(7.5, range=0..10),
    Stepback_dim=Slider(2.5, range=0..10),
    Stepback_ref=geo_5,
    Stepback_tol=number_slider_4,
    Run=toggle)

miru_10 = PythonScript(
    Code=file_2,
    Height_dim=Slider(7.5, range=0..10),
    Stepback_dim=Slider(5, range=0..10),
    Stepback_ref=geo_4,
    Stepback_tol=number_slider_3,
    Run=toggle)

# ---- group: PERIMETER
miru_11 = PythonScript(Code=file_9, Width=Slider(35, range=0..100), Court_ref="0", Run=Toggle(True))

# ---- group: HEIGHT
miru_12 = PythonScript(Code=file_12, Height=data_3, Height_ref="MidRes", Run=Toggle(True))

# ---- group: TREE RULES
miru_13 = PythonScript(Code=file_14, Node=bibil_7.Node_out, Run=toggle_2)

# ----
panel = Panel("HiResTower")

# ---- group: SHAPENODE
bibil_9 = PythonScript(
    Code=file_7,
    Rule_in=flatten([miru_13, miru_11, miru_12, miru_9, miru_10]),
    Node_in=flatten([g_3, g_4]),
    Label_="MidRes",
    Run=Toggle(True))  # -> Node_out, Debug

# ----
panel_2 = Panel("-1")
# TOWERS
toggle_3 = BooleanToggle(True)
panel_3 = Panel("MidRes")
geo_6 = Geometry(bibil_9.Debug)

# ---- group: PACKING
separatedata_2 = Ladybug_SeparateData(Code=file_10, X_keep_omit="19.0,25.0", Y_keep_omit="40.0,25.0", Run=Toggle(True))

# ---- group: EXTRACT_SLICE
miru_14 = PythonScript(Code=file_17, Run=toggle_3)

# ---- group: HEIGHT
miru_15 = PythonScript(Code=file_12, Height_ref=Slider(10, range=0..10), Run=Toggle(True))

# ----
g_5 = PythonScript(node=bibil_9.Node_out)  # -> street; inputs node: list
# ---------- g_5: Python ----------
node = filter(lambda n: n!=None,node)
if node and node != []:
    street = []
    for n in node:
        loc = n.backtrack_tree(lambda n: n.grammar.type.has_key('street_tolerance_curve'),accumulate=True)
        street.extend(map(lambda n:n.grammar.type['street_tolerance_curve'],loc))
    if street:
        street = reduce(lambda x,y:x+y,street)
    print street
# ---------- end g_5 ----------
number_slider_6 = Slider(2, range=0..10)  # disabled
g_6 = PythonScript(node=bibil_9.Node_out)  # -> geom; inputs node: list; same code as g
number_slider_7 = Slider(0, range=0..1)  # disabled
python_2 = PythonScript()  # -> out, a
# ---------- python_2: Python ----------
import rhinoscriptsyntax as rs
import Rhino as rc
import scriptcontext as sc


#rs.IsCurveClosed()

#rc.Geometry.Curve.CreateControlPointCurve()

#print 1E-10

#print 1E+10
# ---------- end python_2 ----------
dash = DashPattern(Curve=g_5, Pattern=Slider(2, range=0..10))  # -> Dashes, Gaps
item = ListItem(List=bibil_9.Node_out, Index=number_slider_6, Wrap=True)  # disabled
preview_3 = CustomPreview(Geometry=dash.Dashes, Shader=ColourSwatch(SwatchColor=RGB(255, 255, 255)))
g_7 = PythonScript(node=item)  # -> geom; inputs node: list; disabled; same code as g
wires = BrepWireframe(Brep=g_7, Density=-1)  # disabled

# ---- group: SHAPENODE
bibil_10 = PythonScript(
    Code=file_7,
    Rule_in=flatten([miru_14, separatedata_2, miru_15]),
    Node_in=flatten(bibil_9.Node_out),
    Label_="HiResTower",
    Run=Toggle(True))  # -> Node_out, Debug

# ----
Z = UnitZ(Factor=Slider(-22.5, range=-25..12))
python_3 = PythonScript()  # -> a, b
# ---------- python_3: Python ----------
import rhinoscriptsyntax as rs
import scriptcontext as sc

Shape = sc.sticky['Shape']

cpt = rs.CurveAreaCentroid(x)[0]

S = Shape()

if S.is_near_zero(cpt[2]):
    a = x
else:
    b = x
# ---------- end python_3 ----------
move = Move(Geometry=python_3.b, Motion=Z)  # -> Geometry, Transform
geo_7 = Geometry()
dash_2 = DashPattern(Curve=[move.Geometry, python_3.a], Pattern=Slider(2, range=0..10))  # -> Dashes, Gaps
previewlw = CustomPreviewLineweights(Geometry=dash_2.Dashes, Shader=ColourSwatch(SwatchColor=RGB(128, 128, 128)), Thickness=Slider(2, range=0..10))

swatch = ColourSwatch(SwatchColor=RGB(0, 255, 255))
g_8 = PythonScript(node=bibil_10.Node_out)  # -> geom; inputs node: list
# ---------- g_8: Python ----------
node = filter(lambda n: n!=None,node)
if node and node != []:
    geom = []
    for n in node:
        geom.append(n.shape.geom)
# ---------- end g_8 ----------
geo_8 = Geometry(bibil_10.Debug)
preview_4 = CustomPreview(
    Geometry=g_8,
    Shader={ambient=RGB(0, 0, 0), diffuse=RGB(255, 105, 180), emission=RGB(76, 32, 54), shine=0.5, specular=RGB(255, 255, 255), transparency=0})
preview_5 = CustomPreview(Geometry=geo_8, Shader=swatch)
previewlw_2 = CustomPreviewLineweights(Geometry=geo_8, Shader=swatch, Thickness=Slider(6, range=0..10))

# ---- group: filternull
python_4 = PythonScript(x=[g_6, g_8])  # -> a; inputs x: list
# ---------- python_4: Python ----------
a = filter(lambda n:n!=None,x)
# ---------- end python_4 ----------

# ----
geo_9 = Geometry(python_4)
