# Grasshopper definition trinco_tower_twist_test_11.gh (Grasshopper 0.9.76)
# plug-ins: Python Interpreter

list = ValueList({"dir", "file"}, selected="dir")
python = PythonScript()  # -> out, a
# ---------- python: Python ----------
import os

print os.getcwd()
# ---------- end python ----------

# ---- group: find directory
bibil = PythonScript(
    dir=["C:\\Users\\vasanthakumars\\Documents\\GitHub\\bibil\\src", "C:\\saeran\\master\\git\\bibil\\src"],
    type=list,
    run=Toggle(True))  # -> dir; inputs dir: list
# ---------- bibil: Python ----------
import os
import sys

ghenv.Component.Params.Output[0].Name = "null"
ghenv.Component.Params.Output[0].NickName = "null"

#sys.path.append("C:\Program Files\Rhinoceros 5.0 (64-bit)\System")

if run:
    confirm_dir = None
    for d in dir:
        try:
            if type == "file":
                file_ = open(d)
                file_.close()
            else:
                print os.listdir(d)
            confirm_dir = d
            break
        except Exception as e:
            #print str(e)
            continue
    if confirm_dir != None:
        ghenv.Component.Params.Output[0].Name = type
        ghenv.Component.Params.Output[0].NickName = type
        dir = confirm_dir
        file = confirm_dir
null = None
# ---------- end bibil ----------

# ---- group: tree
python_script = PythonScript(i=bibil)  # -> o
# ---------- python_script: Python ----------
import os

if i:
    o = os.path.join(str(i),"bibil\\bibil_tree.py")
# ---------- end python_script ----------
file = ReadFile(File=python_script, PerLineParse=False)
bibil_2 = PythonScript(Code=file)

# ---- group: grammar
python_script_2 = PythonScript(i=bibil)  # -> o
# ---------- python_script_2: Python ----------
import os

if i:
    o = os.path.join(str(i),"bibil\\bibil_grammar.py")
# ---------- end python_script_2 ----------
file_2 = ReadFile(File=python_script_2, PerLineParse=False)
bibil_3 = PythonScript(Code=file_2)

# ---- group: shape
python_script_3 = PythonScript(i=bibil)  # -> o
# ---------- python_script_3: Python ----------
import os

if i:
    o = os.path.join(str(i),"bibil\\bibil_shape.py")
#o = os.path.join(str(i),"research\\bibil_shape_shape_3d_2d.py")
# ---------- end python_script_3 ----------
file_3 = ReadFile(File=python_script_3, PerLineParse=False)
bibil_4 = PythonScript(Code=file_3)

# ---- group: bula
python_script_4 = PythonScript(i=bibil)  # -> o
# ---------- python_script_4: Python ----------
import os

if i:
    o = os.path.join(str(i),"bula\\bula_minimal.py")
# ---------- end python_script_4 ----------
file_4 = ReadFile(File=python_script_4, PerLineParse=False)
bibil_5 = PythonScript(Code=file_4)

# ---- group: UI
python_script_5 = PythonScript(i=bibil)  # -> o
# ---------- python_script_5: Python ----------
import os

if i:
    o = os.path.join(str(i),"bibil\\bibil_UI.py")
# ---------- end python_script_5 ----------
file_5 = ReadFile(File=python_script_5, PerLineParse=False)

# ---- group: grammar_divide
python_script_6 = PythonScript(i=bibil)  # -> o
# ---------- python_script_6: Python ----------
import os

if i:
    o = os.path.join(str(i),"miru\\miru_divide.py")
# ---------- end python_script_6 ----------
file_6 = ReadFile(File=python_script_6, PerLineParse=False)

# ---- group: grammar_courtyard
python_script_7 = PythonScript(i=bibil)  # -> o
# ---------- python_script_7: Python ----------
import os

if i:
    o = os.path.join(str(i),"miru\\miru_court.py")
# ---------- end python_script_7 ----------
file_7 = ReadFile(File=python_script_7, PerLineParse=False)

# ---- group: grammar_tower
python_script_8 = PythonScript(i=bibil)  # -> o
# ---------- python_script_8: Python ----------
import os

if i:
    o = os.path.join(str(i),"miru\\miru_packing.py")
# ---------- end python_script_8 ----------
file_8 = ReadFile(File=python_script_8, PerLineParse=False)

# ---- group: stepback
python_script_9 = PythonScript(i=bibil)  # -> o
# ---------- python_script_9: Python ----------
import os

if i:
    o = os.path.join(str(i),"miru\\miru_stepback.py")
# ---------- end python_script_9 ----------
file_9 = ReadFile(File=python_script_9, PerLineParse=False)

# ---- group: grammar_height
python_script_10 = PythonScript(i=bibil)  # -> o
# ---------- python_script_10: Python ----------
import os

if i:
    o = os.path.join(str(i),"miru\\miru_height.py")
# ---------- end python_script_10 ----------
file_10 = ReadFile(File=python_script_10, PerLineParse=False)

# ---- group: grammar_analysis_pts
python_script_11 = PythonScript(i=bibil)  # -> o
# ---------- python_script_11: Python ----------
import os

if i:
    o = os.path.join(str(i),"miru\\miru_analysis.py")
# ---------- end python_script_11 ----------
file_11 = ReadFile(File=python_script_11, PerLineParse=False)

# ---- group: meta_tree
python_script_12 = PythonScript(i=bibil)  # -> o
# ---------- python_script_12: Python ----------
import os

if i:
    o = os.path.join(str(i),"miru\\miru_meta_tree.py")
# ---------- end python_script_12 ----------
file_12 = ReadFile(File=python_script_12, PerLineParse=False)

# ---- group: land_use
python_script_13 = PythonScript(i=bibil)  # -> o
# ---------- python_script_13: Python ----------
import os

if i:
    o = os.path.join(str(i),"miru\\miru_landuse.py")
# ---------- end python_script_13 ----------
file_13 = ReadFile(File=python_script_13, PerLineParse=False)

# ---- group: shape2height
python_script_14 = PythonScript(i=bibil)  # -> o
# ---------- python_script_14: Python ----------
import os

if i:
    o = os.path.join(str(i),"miru\\miru_shape2height.py")
# ---------- end python_script_14 ----------
file_14 = ReadFile(File=python_script_14, PerLineParse=False)

# ---- group: extract_slice
python_script_15 = PythonScript(i=bibil)  # -> o
# ---------- python_script_15: Python ----------
import os

if i:
    o = os.path.join(str(i),"miru\\miru_extract_slice.py")
# ---------- end python_script_15 ----------
file_15 = ReadFile(File=python_script_15, PerLineParse=False)

# ----
list_2 = ValueList({"divide by depth": "subdivide_depth", "divide by same depth": "subdivide_depth_same", "divide by dim": "subdivide_dim"}, selected="divide by same depth")
list_3 = ValueList({"YZ": "NS", "XZ": "EW", "XY": "Z"}, selected="XZ")

# ---- group: PACKING
separatedata = Ladybug_SeparateData(Code=file_8, X_keep_omit="27.0,25.0", Y_keep_omit="27.0,25.0", Seperation_ref="-1", Run=Toggle(True))

# ---- group: EXTRACT_SLICE
miru = PythonScript(Code=file_15, Run=Toggle(False))

# ---- group: DIVIDE
miru_2 = PythonScript(
    Code=file_6,
    Divide_num=Slider(2, range=0..10),
    Divide_cut=Slider(0, range=0..100),
    Divide_type=list_2,
    Divide_ratio=Slider(0.5, range=0..1),
    Axis=list_3,
    Run=Toggle(False))

# ---- group: PERIMETER
miru_3 = PythonScript(Code=file_7, Width=Slider(20, range=0..100), Cut_width=Slider(0, range=0..100), Court_ref="0", Run=Toggle(False))

# ---- group: HEIGHT
miru_4 = PythonScript(Code=file_10, Height=Slider(16.5, range=0..100), Run=Toggle(True))

# ---- group: TREE RULES
miru_5 = PythonScript(Code=file_12, Run=Toggle(False))

# ---- group: SHAPE2HEIGHT
miru_6 = PythonScript(Code=file_14, Run=Toggle(False))

# ---- group: d04
geo = Geometry([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])

# ----
geo_2 = Geometry([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])
bibil_6 = PythonScript(Code=file_5, Node_in=flatten(geo), Label_="d04", Run=Toggle(True))  # -> Node_out, Debug
python_2 = PythonScript(
    reslst=geo_2,
    demand_in=bibil_6.Node_out,
    demand_index=Slider(0, range=0..4),
    var_index=Slider(0, range=0..11),
    run=Toggle(True))  # -> hi_res, hi_com, midhi_res, midlo_res, midhi_com, midlo_com, lo_res, lo_com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; inputs reslst: list, comlst: list, demand_in: list, var_index: Int32
# ---------- python_2: Python ----------
import random
import scriptcontext as sc
import Rhino as rc
import rhinoscriptsyntax as rs

Bula = sc.sticky['Bula']
sc.sticky['GLOBAL_COLLISION_LIST'] = []

def set_density(parcel):
    #This should be part of the mapping function in Bula
    lo,mid1,mid2,hi = [],[],[],[]
    MIN_HI_DIST = 45.0
    MIN_MID_DIST = 24.0
    for i,p in enumerate(parcel):
        x_dist = p.shape.x_dist
        y_dist = p.shape.y_dist
        demand_ = p.shape.ht
        #print i,': ', round(demand_,2)
        # HIRISE
        if demand_ > 31.5 and x_dist > MIN_HI_DIST and y_dist > MIN_HI_DIST:
            hi.append(p)
        # MIDRISE
        elif demand_ > 7.5 and x_dist > MIN_MID_DIST and y_dist > MIN_MID_DIST:
            if demand_ > 22.5:
                mid2.append(p)
            else:
                mid1.append(p)
        # LOWRISE
        else:
            #lowrise
            lo.append(p)
    print '---'
    return hi,mid2,mid1,lo

def parcel_by_zone(parcel_,zone_):
    #debug = sc.sticky['debug']
    L = []
    cpt = parcel_.shape.cpt
    for j in xrange(len(zone_)):
        zonecrv = zone_[j]
        #debug.append(zonecrv)
        IsIn = rs.PointInPlanarClosedCurve(cpt,zonecrv)
        if IsIn>0.5:
            IsDefined = True
            #debug.append(parcel)
            L.append(parcel)
            break
    return L


if run:
    D={}
    max = 0.
    min = 100.
    
    htlst = []
    for n in demand_in:
        ht = n.shape.ht
        if ht>max:
            max = ht
        if ht<min:
            min = ht
        htlst.append(ht)
    B = Bula()
    
    normlst = B.normalize_list(htlst,191.5,4.5)
    
    
    for i,n in enumerate(demand_in):
        n.shape.op_extrude(normlst[i])
        label = n.grammar.type['label']
        if D.has_key(label):
            D[label].append(n)
        else:
            D[label] = [n]
    
    L = D.values()
    L.sort(key=lambda lst:lst[0].grammar.type['label'])
    
    
    
    parcels = L[index]

    res,com = [],[]
    
    #sc.doc = rc.RhinoDoc.ActiveDoc
    #lst_res_zone = rs.ObjectsByLayer("_rule_residential")
    #lst_com_zone = rs.ObjectsByLayer("_rule_commercial")
    lst_res_zone = reslst
    lst_com_zone = comlst
    
    for i in xrange(len(parcels)):
        parcel = parcels[i]
        res += parcel_by_zone(parcel,lst_res_zone)
        com += parcel_by_zone(parcel,lst_com_zone)


if run:
    ###
    steplst = map(lambda i: i*1.5,range(1,4))
    seplst = map(lambda i:20+(2.5*i),range(1,5))
    
    
    indexnum = len(steplst)*len(seplst)
    #print indexnum
    #print len(demand)
    
    count = 0
    L = []
    #for dem in demandlst:
    stp = [steplst[0]]
    sep = [seplst[0]]
    #for stp in steplst:
    #    for sep in seplst:
    
    hir_,mdr_2,mdr_1,lor_,hic_,mdc_2,mdc_1,loc_ = [],[],[],[],[],[],[],[]
    #print 'res'
    hir_,mdr_2,mdr_1,lor_ = set_density(res)
    #print 'com'
    #hic_,mdc_2,mdc_1,loc_ = set_density(com)
    L.append((stp,sep,None,hir_,hic_,mdr_2,mdc_2,mdr_1,mdc_1,lor_,loc_))
                
    #print count
    index = var_index
    var_a = L[index][0]
    var_b = L[index][1]
    var_c = L[index][2]
    
    hi_res = L[index][3]
    hi_com = L[index][4]
    midhi_res = L[index][5]
    midhi_com = L[index][6]
    midlo_res = L[index][7]
    midlo_com = L[index][8]
    lo_res = L[index][9]
    lo_com = L[index][10]
    #print lo_com
    print "variables: ", var_a, var_b, var_c
# ---------- end python_2 ----------
g = PythonScript(node=[python_2.midhi_res, python_2.midlo_res, python_2.lo_res, python_2.hi_res])  # -> geom; inputs node: list
# ---------- g: Python ----------
node = filter(lambda n: n!=None,node)
if node and node != []:
    geom = []
    for n in node:
        geom.append(n.shape.geom)
    print geom
# ---------- end g ----------
g_2 = PythonScript(node=[python_2.hi_com, python_2.midhi_com, python_2.midlo_com, python_2.lo_com])  # -> geom; inputs node: list; same code as g
data = Data(python_2.var_c)
data_2 = Data(python_2.var_a)
data_3 = Data(python_2.var_b)

# ---- group: META-RES
# HI-RESIDENTIAL
bibil_7 = PythonScript(Code=file_5, Node_in=flatten(geo_2), Run=Toggle(True))  # -> Node_out, Debug

# ----
geo_3 = Geometry(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)

# ---- group: SETBACK
miru_7 = PythonScript(Code=file_9, Height_stepback="6.0:6.0", Stepback_ref=geo_3, Run=Toggle(False))

miru_8 = PythonScript(Code=file_9, Height_stepback="9.0:12.0", Stepback_ref="0", Run=Toggle(True))

# ---- group: PERIMETER
miru_9 = PythonScript(Code=file_7, Width=Slider(34, range=0..100), Cut_width=Slider(0, range=0..100), Court_ref="0", Run=Toggle(False))

# ---- group: TREE RULES
miru_10 = PythonScript(Code=file_12, Node=bibil_7.Node_out, Run=Toggle(True))

# ----
geo_4 = Geometry([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])

# ---- group: SHAPENODE
bibil_8 = PythonScript(Code=file_5, Rule_in=flatten([miru_10, miru_9, miru_7, miru_8]), Node_in=flatten(geo_4), Run=Toggle(True))  # -> Node_out, Debug

# ----
g_3 = PythonScript(node=bibil_8.Node_out)  # -> geom; inputs node: list
# ---------- g_3: Python ----------
node = filter(lambda n: n!=None,node)
if node and node != []:
    geom = []
    for n in node:
        if n.shape.z_dist < 1.2:
            geom.append(n.shape.bottom_crv)
        else:
            geom.append(n.shape.geom)
    print geom
# ---------- end g_3 ----------
geo_5 = Geometry(bibil_8.Debug)
python_3 = PythonScript(kp=Slider(27, range=0..100), om=data_3)  # -> stp_str
# ---------- python_3: Python ----------
stp_str = str(kp) + "," + str(om)

print stp_str
# ---------- end python_3 ----------
panel = Panel("27.0,25.0")
panel_2 = Panel(python_3)

# ---- group: PACKING
separatedata_2 = Ladybug_SeparateData(Code=file_8, X_keep_omit=python_3, Y_keep_omit=python_3, Seperation_ref="-1", Run=Toggle(True))

# ---- group: EXTRACT_SLICE
miru_11 = PythonScript(Code=file_15, Run=Toggle(True))

# ---- group: SHAPENODE
bibil_9 = PythonScript(Code=file_5, Rule_in=flatten([miru_11, separatedata_2]), Node_in=flatten(bibil_8.Node_out), Run=Toggle(False))  # -> Node_out, Debug

# ----
g_4 = PythonScript(node=bibil_9.Node_out)  # -> nodekeep, nodeomit; inputs node: list
# ---------- g_4: Python ----------
node = filter(lambda n: n!=None,node)
if node and node != []:
    nodekeep,nodeomit = [],[]
    for i,n in enumerate(node):
        if 'keep' in n.grammar.type['grammar']:
            nodekeep.append(n)
        else:
            nodeomit.append(n)
# ---------- end g_4 ----------
list_4 = ValueList({"divide by depth": "subdivide_depth", "divide by same depth": "subdivide_depth_same", "divide by dim": "subdivide_dim"}, selected="divide by same depth")
list_5 = ValueList({"YZ": "NS", "XZ": "EW", "XY": "Z"}, selected="XZ")
g_5 = PythonScript(node=g_4.nodeomit)  # -> geom; inputs node: list; same code as g_3

# ---- group: DIVIDE
miru_12 = PythonScript(
    Code=file_6,
    Divide_num=Slider(1, range=0..10),
    Divide_cut=Slider(0, range=0..100),
    Divide_type=list_4,
    Divide_ratio=Slider(0.5, range=0..1),
    Axis=list_5,
    Run=Toggle(False))

# ---- group: HEIGHT
miru_13 = PythonScript(Code=file_10, Height=Slider(6, range=0..100), Randomize="-3.0>6.0", Run=Toggle(True))

miru_14 = PythonScript(Code=file_10, Height=Slider(100, range=0..100), Run=Toggle(True))

# ---- group: SHAPENODE
bibil_10 = PythonScript(Code=file_5, Rule_in=flatten(miru_14), Node_in=flatten(g_4.nodekeep), Run=Toggle(False))  # -> Node_out, Debug

bibil_11 = PythonScript(Code=file_5, Rule_in=flatten([miru_12, miru_13]), Node_in=flatten(g_4.nodeomit), Run=Toggle(False))  # -> Node_out, Debug

# ----
g_6 = PythonScript(node=bibil_10.Node_out)  # -> geom; inputs node: list; same code as g
g_7 = PythonScript(node=bibil_11.Node_out)  # -> geom; inputs node: list; same code as g_3
g_8 = PythonScript(node=bibil_10.Node_out)  # -> geom; inputs node: list; same code as g_3
g_9 = PythonScript(node=bibil_8.Node_out)  # -> geom; inputs node: list; same code as g_3
# HI-RESIDENTIAL
swatch = ColourSwatch(SwatchColor=RGB(255, 255, 255))
material = CreateMaterial(Diffuse=swatch, Specular=RGB(255, 255, 255), Emission=RGB(0, 0, 0), Transparency=Slider(0.2, range=0..1), Shine=0)
preview = CustomPreview(Geometry=[g_7, g_8, g_9], Shader=material)
